vi "index.gviweb"   [LabVIEW NXG 5.0.0]
panel controls:
  "Timezone": string
panel indicators:
  "Connected?": bool
  "RX Data": string
  "WebSockets URL": string
  "Last Error": string
types:
  T1 = cluster{"WebSockets URL": string, "WebSocket Session": u32, "Connected?": bool, "Message In": string, "Message Out": string}
uses:
  JKI::Library::JKI State Machine::Add State(s) to Queue.gvi
  JKI::Library::JKI State Machine::Parse State Queue.gvi
  NI::G Core::Error::Build Error Cluster.gvi
  WebApp::GetHostname.jsli::GetHostname
  NI::WebSockets::Close WebSocket.gvi
  NI::G Core::Error::Clear Error Cluster.gvi
  NI::WebSockets::Open WebSocket.gvi
  NI::WebSockets::Read String.gvi
  NI::WebSockets::Write String.gvi
diagram:
  call "Add State(s) to Queue.gvi"(State(s) in ("")="Macro: Initialize") -> (States Out=w1)
  # This has been modified from the JKI State Machine NXG 3.0 available at https://github.com/JKISoftware/JKI-State-Machine-NXG/tree/master/source.  Instead of building a package the required VIs have been added to this project.  The items not supported by a Web VI have been removed.
  # = State Syntax =
  # StateCategory: State >> Argument
  # Line Terminator: Line feed
  # Example:
  # UI: Help >> About
  #
  # Where "UI" is the state category
  # Where "Help" is the state
  # Where "About" is the argument
  # Other Examples:
  # App Data: Initialize
  # UI: Initialize
  # Help >> About
  #
  # = Commenting =
  # To add a comment use "//" or "#" and all text to the right will be ignored
  # Commenting Example:
  # UI: Initialize // This initializes the UI
  # # This whole line is a comment
  # // Another comment line
  # For instructions on how to use the JKI State Machine, examples and video tutorials, visit:
  # http://jki.net/state-machine/
  #
  # JKI State Machine™
  # http://jki.net/state-machine/
  # Copyright (C) 2005-2018, JKI <info@jki.net>
  # ALL RIGHTS RESERVED
  s1 = uninitialised  # shift register
  s2 = uninitialised  # shift register
  s3 = w1  # shift register
  while {
    call "Parse State Queue.gvi"(State Queue=s3, Error In (no error)=s2) -> (Remaining States=w2, Current State=w3, Arguments=w4)
    w5 = 250  # Timeout
    # JKI State Machine NXG 3.0				Template Copyright © 2018 JKI	 - http://jki.net/state-machine
    # -1 =
    # wait
    # forever
    case (w3) ignore case {
      frame "", "Event Structure", "Idle" {
        # executes when the state queue is empty
        event (timeout = w5) {
          on "Timeout" {
            Property Node(instance in=s1) -> ("Connected?"=w10)
            Select(s=w10, t="Comm: Read", f="Comm: Connecting") -> w11
            # Timeout Frame
            # (this will only execute if the Event Structure timeout is >= 0)
            call "Add State(s) to Queue.gvi"(State(s) in Front ("")=w11, State(s) in ("")=w2, State(s) at Back ("")="UI: Update") -> (States Out=w7)
            w6 = s2
            w9 = s1
          }
          on "Timezone" Value changed {
            # Timeout Frame
            # (this will only execute if the Event Structure timeout is >= 0)
            call "Add State(s) to Queue.gvi"(State(s) in ("")=w2, State(s) at Back ("")="UI: Process Timezone") -> (States Out=w7)
            w6 = s2
            w9 = s1
          }
        }
        w8 = default
      }
      frame "---------- Core ----------" {
        # Do not put any code in this frame.
        # (it is a separator no-op)
        call "Add State(s) to Queue.gvi"(State(s) in ("")=w2) -> (States Out=w7)
        w6 = s2
        w8 = default
        w9 = s1
      }
      frame Default {
        # Do not delete, rename, or modify this frame.
        # (this is used to capture unhandled states and typos)
        call "Add State(s) to Queue.gvi"(State(s) in ("")=w2) -> (States Out=w7)
        Format Into String(formatString="Software Exception: Unhandled State \"%s\".", errIn=s2, w3) -> (outString=w12, errOut=w13)
        # Handle mistyped state name (developer tool)
        call "Build Error Cluster.gvi"(code="Generic error"(42), description=w12, error in=w13, include call chain=TRUE) -> (error out=w6)
        w8 = default
        w9 = s1
      }
      frame "Error Handler" {
        # Handle any errors here.
        # You can also output any states to clean-up after errors occur
        call "Add State(s) to Queue.gvi"(State(s) in Front ("")="/* Post Error States", State(s) in ("")=w2) -> (States Out=w7)
        # Clear error
        # Unhandled Error -- Display it
        Property Node(instance in=s2) -> ("source"=w14)
        $"Last Error" <- w14
        w6 = no error
        w8 = default
        w9 = s1
      }
      frame "Exit" {
        # Do not put any code in this frame.
        # (No errors that occur here will be handled.)
        call "Add State(s) to Queue.gvi"(State(s) in ("")=w2) -> (States Out=w7)
        w15 = TRUE  # Stop
        w6 = s2
        w8 = w15
        w9 = s1
      }
      frame "---------- Data ----------" {
        # Do not put any code in this frame.
        # (It is a separator no-op. You can make a copy of this frame to create a new Data frame)
        call "Add State(s) to Queue.gvi"(State(s) in ("")=w2) -> (States Out=w7)
        w6 = s2
        w8 = default
        w9 = s1
      }
      frame "Data: Initialize" {
        # Initialize the shift-register data, here.
        # (data names are defined by what you wire into the bundle function)
        call "Add State(s) to Queue.gvi"(State(s) in ("")=w2) -> (States Out=w7)
        # Data names and types of shift register data are defined by this bundle.
        # Add new data here.
        w6 = s2
        w8 = default
        w9 = T1 {all zero or empty}
      }
      frame "Data: Cleanup" {
        # Cleanup any data and references, here.
        # (this is called automatically, by the Macro: Exit)
        call "Add State(s) to Queue.gvi"(State(s) in ("")=w2) -> (States Out=w7)
        w6 = s2
        w8 = default
        w9 = s1
      }
      frame "---------- UI ----------" {
        # Do not put any code in this frame.
        # (It is a separator no-op. You can make a copy of this frame to create a new UI frame)
        call "Add State(s) to Queue.gvi"(State(s) in ("")=w2) -> (States Out=w7)
        w6 = s2
        w8 = default
        w9 = s1
      }
      frame "UI: Initialize" {
        # Initialize the User Interface, here.
        # (this is called automatically, by the Macro: Init)
        call "Add State(s) to Queue.gvi"(State(s) in ("")=w2) -> (States Out=w7)
        w6 = s2
        w8 = default
        w9 = s1
      }
      frame "UI: Update" {
        # Update the User Interface, here.
        # (this is called automatically, by the Macro: Init and during Timeout)
        call "Add State(s) to Queue.gvi"(State(s) in ("")=w2) -> (States Out=w7)
        Property Node(instance in=s1) -> ("WebSockets URL"=w16, "Connected?"=w17, "Message In"=w18)
        $"WebSockets URL" <- w16
        $"Connected?" <- w17
        $"RX Data" <- w18
        w6 = s2
        w8 = default
        w9 = s1
      }
      frame "UI: Process Timezone" {
        # Update the User Interface, here.
        # (this is called automatically, by the Macro: Init and during Timeout)
        call "Add State(s) to Queue.gvi"(State(s) in ("")=w2, State(s) at Back ("")="Comm: Write") -> (States Out=w7)
        Property Node(instance in=reference to "Timezone", error in=s2) -> ("Value"=w19, error out=w20)
        w21 = cluster{"Command": string, "Timezone": string} {all zero or empty}
        Property Node(instance in=w21, "Command"="Timezone", "Timezone"=w19) -> (instance out=w22)
        Flatten To Json(anything=w22, error in (no error)=w20) -> (JSON string=w23, error out=w6)
        Property Node(instance in=s1, "Message Out"=w23) -> (instance out=w9)
        w8 = default
      }
      frame "---------- Macro ----------" {
        # Do not put any code in this frame.
        # (It is a separator no-op. You can make a copy of this frame to create a new Macro frame)
        call "Add State(s) to Queue.gvi"(State(s) in ("")=w2) -> (States Out=w7)
        w6 = s2
        w8 = default
        w9 = s1
      }
      frame "Macro: Initialize" {
        # Initialization Macro
        # (This is called once, when the VI starts)
        w24 = "Data: Initialize\nUI: Initialize\nUI: Update\nComm: Initialize\nUI: Update"
        call "Add State(s) to Queue.gvi"(State(s) in Front ("")=w24, State(s) in ("")=w2) -> (States Out=w7)
        w6 = s2
        w8 = default
        w9 = s1
      }
      frame "Macro: Exit" {
        # Exit Macro
        # (This is called once, when the VI exits)
        call "Add State(s) to Queue.gvi"(State(s) in Front ("")="Data: Cleanup\nExit", State(s) in ("")=w2) -> (States Out=w7)
        w6 = s2
        w8 = default
        w9 = s1
      }
      frame "---------- Comm ----------" {
        # Template Separator
        # (You can make a copy of, or modify, this frame)
        call "Add State(s) to Queue.gvi"(State(s) in ("")=w2) -> (States Out=w7)
        w6 = s2
        w8 = default
        w9 = s1
      }
      frame "Comm: Initialize" {
        # Comm: Initialize
        # (Establishes a connection with the webserver.)
        call "Add State(s) to Queue.gvi"(State(s) in ("")=w2) -> (States Out=w7)
        # Change this according to whether it's being hosted on the Pi (e.g. localhost) or you are accessing remotely (Pi IP address)
        disable {
          frame Disabled {
            # Use to test running locally.
            w25 = "ws://192.168.1.116:6123"
          }
          frame Enabled {
            call "GetHostname"() -> (return=w26, error out=w27)
            Format Into String(formatString="ws://%s:6123", errIn=w27, w26) -> (outString=w25, errOut=w6)
          }
        }
        Property Node(instance in=s1, "WebSockets URL"=w25) -> (instance out=w9)
        w8 = default
      }
      frame "Comm: Connecting" {
        # Comm: Connecting
        # (Establish a WebSockets connection.)
        call "Add State(s) to Queue.gvi"(State(s) in ("")=w2) -> (States Out=w7)
        Property Node(instance in=s1) -> ("WebSockets URL"=w28, "WebSocket Session"=w29, instance out=w30)
        call "Close WebSocket.gvi"(websocket session in=w29, error in=s2) -> (error out=w31)
        call "Clear Error Cluster.gvi"(error in=w31) -> (error out=w32)
        call "Open WebSocket.gvi"(url=w28, error in=w32) -> (websocket session out=w33, error out=w34)
        Not(x=w34) -> w35
        Property Node(instance in=w30, "WebSocket Session"=w33, "Connected?"=w35) -> (instance out=w9)
        call "Clear Error Cluster.gvi"(error in=w34) -> (error out=w6)
        w8 = default
      }
      frame "Comm: Read" {
        # Comm: Read
        # (Read any available message.)
        call "Add State(s) to Queue.gvi"(State(s) in ("")=w2) -> (States Out=w7)
        Property Node(instance in=s1) -> ("WebSocket Session"=w36, instance out=w37)
        call "Read String.gvi"(websocket session in=w36, timeout=5, error in=s2) -> (websocket session out=w38, string response=w39, error out=w40)
        Not(x=w40) -> w41
        Property Node(instance in=w37, "WebSocket Session"=w38, "Message In"=w39, "Connected?"=w41) -> (instance out=w9)
        call "Clear Error Cluster.gvi"(error in=w40) -> (error out=w6)
        w8 = default
      }
      frame "Comm: Write" {
        # Comm: Write
        # (Write available message.)
        call "Add State(s) to Queue.gvi"(State(s) in ("")=w2) -> (States Out=w7)
        Property Node(instance in=s1) -> ("WebSocket Session"=w42, "Message Out"=w43, instance out=w44)
        call "Write String.gvi"(websocket session in=w42, string message=w43, error in=s2) -> (websocket session out=w45, error out=w46)
        Not(x=w46) -> w47
        Property Node(instance in=w44, "WebSocket Session"=w45, "Connected?"=w47) -> (instance out=w9)
        call "Clear Error Cluster.gvi"(error in=w46) -> (error out=w6)
        w8 = default
      }
    }
    next s1 = w9
    next s2 = w6
    next s3 = w7
    stop if w8
  }
